# Grasshopper definition springOut.ghx (Grasshopper 0.8.10)

division = Division(A="300", B=2)
division_2 = Division(A="300", B=-2)
pt = Point(<point referenced from the Rhino model>)
pt_2 = PointXYZ(XComponent=0, YComponent=0, ZComponent=0)
trigrid = Triangular(Plane=PlaneXY(0, 0, 0), Size=Slider(50, range=0..50), ExtentX=Slider(7, range=0..10), ExtentY=Slider(4, range=0..10))  # -> Cells, Points
dom = Domain(DomainStart=division_2, DomainEnd=division)
vec2pt = Vector2Pt(PointA=pt_2, PointB=pt, Unitize=False)  # -> Vector, Length
rectangle = Rectangle(Plane=PlaneXY(0, 0, 0), XSize=dom, YSize=dom, Radius=0)  # -> Rec, Length
move = Move(Geometry=flatten(trigrid.Cells), Translation=vec2pt.Vector)  # -> Geometry, Transform
explode = Explode(Curve=rectangle.Rec, Recursive=True)  # -> Segments, Vertices
explode_2 = Explode(Curve=move.Geometry, Recursive=True)  # -> Segments, Vertices
bbox = BoundingBox(Content=move.Geometry, Union=True, Plane=PlaneXY(0, 0, 0))  # -> Box, Box_2
duppt = RemoveDuplicatePts(Points=explode.Vertices, Tolerance=0.01)
flatten = FlattenTree(Data=explode_2.Vertices, Path="{0}")
explode_3 = BrepComponents(Brep=bbox.Box)  # -> Faces, Edges, Vertices
duppt_2 = RemoveDuplicatePts(Points=flatten, Tolerance=0.01)
flatten_2 = FlattenTree(Data=explode_2.Segments, Path="{0}")
ln = Line(PointA=duppt, PointB=explode_3.Vertices)
dupln = RemoveDuplicateLines(Lines=flatten_2, Tolerance=0.01)
merge = Merge(StreamA=flatten(duppt), StreamB=flatten(duppt_2))
crv = Curve(flatten([ln, dupln]))
flatten_3 = FlattenTree(Data=merge, Path="{0}")
end = EndPoints(Curve=crv)  # -> Start, End
pcomp = Decompose(Point=flatten_3)  # -> XComponent, YComponent, ZComponent
vb = VBScript(x=flatten_3, y=end.Start)  # -> out, A; inputs x: list of Point3d, y: Point3d
# ---------- vb: VB ----------
    'your code goes here…
    Dim n As New Integer
    For i As Integer = 0 To x.Count - 1 Step 1
      If y.DistanceTo(x.Item(i)) < 0.1 Then
        n = i
      End If
    Next
    A = n
# ---------- end vb ----------
vb_2 = VBScript(x=pcomp.XComponent, y=pcomp.YComponent, z="300")  # -> out, A
# ---------- vb_2: VB ----------
    'your code goes here…
    A = CStr(x) + "," + CStr(y) + "," + CStr(z / 2)
# ---------- end vb_2 ----------
vb_3 = VBScript(x=flatten_3, y=end.End)  # -> out, A; inputs x: list of Point3d, y: Point3d; same code as vb
panel = Panel(vb_2.A)
panel_2 = Panel(vb.A)
panel_3 = Panel(vb_3.A)
