# Grasshopper definition export.ghx (Grasshopper 0.8.13)

crv = Curve(<curve referenced from the Rhino model>)
cp = ControlPoints(Curve=crv)  # -> Points, Weights, Knots
pcomp = Decompose(Point=cp.Points)  # -> XComponent, YComponent, ZComponent
concat = Concatenate(Start=pcomp.XComponent, End=",")
concat_2 = Concatenate(Start=concat, End=pcomp.YComponent)
panel = Panel(concat_2)
